vi "Main_CallTaskFromWebVI.gviweb"   [LabVIEW NXG 5.0.0]
panel controls:
  "fire_analysis_task": bool
  "Button_2": bool
  "Parameter Task 1": T1
  "Parameter Task 2": cluster{"Numeric_3": f64, "Power Button": bool}
  "Files List": i32 = -1
  "Analysis List": i32
  "Get File Info": bool
panel indicators:
  "Current Task Status": string
  "Channel Data": f64[]
  "TDM File Structure": cluster{"location": string, "data": string}[]
types:
  T1 = cluster{"Numeric": f64, "Numeric_2": f64, "Numeric_3": f64}
  "Message Session.gtype" = cluster{"Configuration": "Configuration.gtype", "token": string}
  "Client Handle.gtype" = u32
  "Configuration.gtype" = cluster{"Server URL": string, "Session": "Client Handle.gtype", "Raw Session Queue": Queue<"Client Handle.gtype">}
  T2 = cluster{"MessageSession": "Message Session.gtype", "names": string[], "IDs": string[], "configuration": "Configuration.gtype"}
uses:
  WebApp::subVIs::Disable_Controls.gviweb
  NI::Skyline::Configuration::Open Configuration.gvi
  NI::Skyline::MessageHTTP::Open.gvi
  WebApp::subVIs::Execute Task.gviweb
  WebApp::subVIs::Get_Tasks.gviweb
  WebApp::subVIs::Get_Indexed_Files.gviweb
  WebApp::subVIs::Retrieve_File_Info.gviweb
  NI::Skyline::MessageHTTP::Subscribe.gvi
  NI::Skyline::MessageHTTP::Read.gvi
diagram:
  w1 = "Initialize"  # States
  s1 = uninitialised  # shift register
  s2 = w1  # shift register
  s3 = T2 {all zero or empty}  # shift register
  while {
    # w2: > App Data >
    # w3: > Next State >
    # w4: > Error >
    case (s2) {
      frame "Initialize" {
        w6 = "Connecto to SystemLink"  # States
        disable {
          frame Enabled {
            w4 = default
          }
          frame Disabled {
            Build Array(reference to "Parameter Task 1", reference to "fire_analysis_task") -> w7
            call "Disable_Controls.gviweb"(Control Reference=w7, Disabled=FALSE) -> (error out=w8)
            Build Array(reference to "Parameter Task 2", reference to "Button_2") -> w9
            call "Disable_Controls.gviweb"(Control Reference=w9, Disabled=TRUE, error in=w8) -> (error out=w4)
          }
        }
        w3 = w6
        w2 = s3
        w5 = "Initializing..."
      }
      frame "Connecto to SystemLink" {
        call "Open Configuration.gvi"(server url="http://ec2-34-213-23-171.us-west-2.compute.amazonaws.com", username="lvadmin", password="LabVIEW===") -> (configuration=w10, error out=w11)
        call "Open.gvi"(error in=w11, configuration=w10) -> (message session=w12, error out=w4)
        Property Node(instance in=s3, "configuration"=w10, "MessageSession"=w12) -> (instance out=w2)
        w13 = "Fire Task"  # States
        w3 = w13
        w5 = "Getting data from the server..."
      }
      frame "Fire Task", Default {
        event (timeout = 5000) {
          on "fire_analysis_task" Value changed {
            Property Node(instance in=s3) -> ("configuration"=w14, "IDs"=w15, instance out=w2)
            Array Index(array=w15) -> (out0[$"Analysis List"]=w16)
            call "Execute Task.gviweb"(configuration=w14, paths=string[] [], task id=w16)
            w3 = "Wait for Task to Complete"
            w5 = "Analysis task fired!"
          }
          on "Timeout" {
            Property Node(instance in=s3) -> ("configuration"=w17, instance out=w18)
            call "Get_Tasks.gviweb"(configuration=w17) -> (IDs=w19, names=w20)
            call "Get_Indexed_Files.gviweb"(configuration=w17) -> (Files List=w21)
            Property Node(instance in=w18, "IDs"=w19, "names"=w21) -> (instance out=w2)
            Property Node(instance in=reference to "Analysis List", "Items"=w20)
            Property Node(instance in=reference to "Files List", "Items"=w21)
            w22 = "Select a task from the Analysis List box and then click the \"Fire Analysis Task\" button. You can also Select one of the TDM files listed to retrieve their TDM structure and see one of their channel data plotted."
            w3 = "Fire Task"
            w5 = w22
          }
          on "Get File Info" Value changed {
            Property Node(instance in=s3) -> ("configuration"=w23, "names"=w24, instance out=w2)
            Array Index(array=w24) -> (out0[$"Files List"]=w25)
            call "Retrieve_File_Info.gviweb"(configuration=w23, TDM_File_Name=w25) -> (Graph=w26, Tree=w27)
            $"Channel Data" <- w26
            $"TDM File Structure" <- w27
            w3 = "Fire Task"
            w5 = "TDM File Loaded!"
          }
        }
        w4 = s1
      }
      frame "Wait for Task to Complete" {
        sequence {
          frame 0 {
            Wait(time to wait=7000)
            $"Current Task Status" <- "Waiting for Task to Complete..."
          }
        }
        Property Node(instance in=s3) -> ("MessageSession"=w28, "configuration:Server URL"=w29, instance out=w2)
        call "Subscribe.gvi"(message session in=w28, topic=w29, error in=s1) -> (message session out=w30, error out=w31)
        call "Read.gvi"(message session in=w30, timeout=10000, error in=w31) -> (dequeue status=w32, message=w33, error out=w34)
        case (w32) {
          frame True {
            w35 = "Wait for Task to Complete"  # States
            w5 = "Waiting for Task to Complete..."
            w3 = w35
            w4 = w34
          }
          frame False {
            w36 = "Fire Task"  # States
            w37 = "Task finished! Choose a task and then hit the \"Fire task!\" button"
            $"Current Task Status" <- w33
            w5 = w37
            w3 = w36
            w4 = w34
          }
        }
      }
    }
    $"Current Task Status" <- w5
    next s1 = w4
    next s2 = w3
    next s3 = w2
    stop if FALSE
  }
