vi "Execute Task.gviweb"   [LabVIEW NXG 5.0.0]
inputs:
  "client handle out_2": "Client Handle.gtype"
  "Server URL out": string
  "paths": string[]
  "task id": string = "a5e96044-3d80-4761-8ea5-70aba0bef7f3"
outputs:
  "Output": string[]
  "concatenated string": string
  "headers": string
  "body": string
types:
  "Client Handle.gtype" = u32
uses:
  NI::HTTP::POST Buffer.gvi
diagram:
  # /nidataanalyzer/v1/executions
  Concatenate Strings($"Server URL out", "/nidataanalyzer/v1/executions") -> w1
  Concatenate Strings("{\n  \"tasks\": [\n    {\n      \"taskId\": \"", $"task id", "\",\n      \"parameters\": [", "]}]}") -> w2
  call "POST Buffer.gvi"(client handle=$"client handle out_2", url=w1, buffer=w2) -> (headers=w3, body=w4)
  $headers <- w3
  $body <- w4
  $"concatenated string" <- w2
