vi "Get_Indexed_Files.gviweb"   [LabVIEW NXG 5.0.0]
inputs:
  "client handle": "Client Handle.gtype"
  "error in": error
outputs:
  "error out": error
  "Files List": string[]
  "body": string
types:
  "Client Handle.gtype" = u32
  T1 = cluster{"type": string, "elemid": i32, "name": string, "fileid": i32, "indexstatus": string, "indexingduration": i32, "errorlog": string, "modifytimeatindexing": string, "composedsize": i32, "dataplugintype": string}
  T2 = cluster{"type": string, "elemid": i32, "name": string, "dirid": i32, "path": string, "createdate": string, "modifydate": string, "filesize": i32, "readonly": bool, "offline": bool, "encrypted": bool, "compressed": bool, "dataplugins": T1[]}
uses:
  NI::HTTP::Add Header.gvi
  NI::HTTP::GET.gvi
diagram:
  w1 = "http://localhost/TDMServer_dfse/datafinders/2bb02b7b-aef6-4a9b-b1bf-3f66ac12fcd6/data?folder_id=3&include_dataplugins=true"
  call "Add Header.gvi"(client handle=$"client handle", header="Accept-Language", value="application/json", error in=$"error in") -> (client handle out=w2, error out=w3)
  call "GET.gvi"(client handle=w2, url=w1, error in=w3) -> (body=w4, error out=w5)
  $body <- w4
  Unflatten From Json(JSON string=w4, default null elements=FALSE, type and defaults=cluster{"files": T2[]} {all zero or empty}) -> (error out=w6, value=w7)
  Merge Errors(w5, w6) -> (error out=w8)
  $"error out" <- w8
  Property Node(instance in=w7) -> ("files"=w9)
  for {
    w10 = each element of w9
    Property Node(instance in=w10) -> ("path"=w12)
    Match Pattern(regular expression="[^\\\\/:*?\"<>|\\r\\n]+$", string=w12) -> (match substring=w13)
    append w13 to w11
  }
  $"Files List" <- w11
