vi "Get_Tasks.gviweb"   [LabVIEW NXG 5.0.0]
inputs:
  "client handle": "Client Handle.gtype"
  "Error In": error
outputs:
  "names": string[]
  "IDs": string[]
  "Error Out": error
  "body": string
types:
  "Client Handle.gtype" = u32
  T1 = cluster{"name": string, "type": string, "value": string, "description": string}
  T2 = cluster{"taskId": string, "name": string, "parameters": T1[]}
  T3 = cluster{"_links": cluster{"self": cluster{"href": string}}, "tasks": T2[]}
uses:
  NI::HTTP::Add Header.gvi
  NI::HTTP::GET.gvi
diagram:
  w1 = "http://localhost/nidataanalyzer/v1/tasks?expand=taskId%3Bname%3Bparameters"
  call "Add Header.gvi"(client handle=$"client handle", header="Accept-Language", value="application/json", error in=$"Error In") -> (client handle out=w2, error out=w3)
  call "GET.gvi"(client handle=w2, url=w1, error in=w3) -> (body=w4, error out=w5)
  # Get the list of tasks names and ID
  $body <- w4
  # JSON String based on the Data Analysis Service HTTP API
  Unflatten From Json(JSON string=w4, type and defaults=T3 {all zero or empty}) -> (error out=w6, value=w7)
  Merge Errors(w5, w6) -> (error out=w8)
  $"Error Out" <- w8
  Property Node(instance in=w7) -> ("tasks"=w9)
  for {
    w10 = each element of w9
    Property Node(instance in=w10) -> ("name"=w13, "taskId"=w14)
    append w13 to w11
    append w14 to w12
  }
  $names <- w11
  $IDs <- w12
