vi "Retrieve_File_Info.gviweb"   [LabVIEW NXG 5.0.0]
inputs:
  "error in": error
  "Client Session In": "Client Handle.gtype"
  "TDM_File_Name": string = "TR_M17_QT_42-4.tdm"
outputs:
  "error out": error
  "Graph": f64[]
  "Tree": cluster{"location": string, "data": string}[]
  "headers": string
types:
  "Client Handle.gtype" = u32
uses:
  NI::HTTP::Add Header.gvi
  NI::HTTP::POST Buffer.gvi
  WebApp::subVIs::Get_Channel_Reference.gviweb
  WebApp::subVIs::Get_Channel_Data.gviweb
  WebApp::subVIs::Populate_TDM_Tree.gviweb
diagram:
  w1 = ["Basic bHZhZG1pbjpMYWJWSUVXPT09", "application/x-asamods+json", "application/x-asamods+json"]
  s1 = $"Client Session In"  # shift register
  for {
    w2 = each element of ["Authorization", "Content-Type", "Accept"]
    w3 = each element of w1
    call "Add Header.gvi"(client handle=s1, header=w2, value=w3, error in=$"error in") -> (client handle out=w4, error out=w5)
    next s1 = w4
  }
  w6 = "{\"variables\":{\"$URL\":{\"stringArray\":{\"values\":[\"corbaname::#Demo_Temperature_Data.ASAM-ODS\"]}}}}"
  call "POST Buffer.gvi"(client handle=s1, url="http://localhost/ni/asam/ods", buffer=w6, error in=w5) -> (client handle out=w7, headers=w8, error out=w9)
  $headers <- w8
  Search Or Split String(search string/char="location: ", string=w8) -> (match + rest of string=w10)
  Pick Line(line index=0, multi-line string=w10) -> (output string=w11)
  String Length(string="location: ") -> (length=w12)
  String Subset(offset (0)=w12, string=w11) -> w13
  Concatenate Strings(w13, "/ni/data-read") -> w14
  s2 = w7  # shift register
  for {
    w15 = each element of ["Authorization", "Content-Type"]
    w16 = each element of ["Basic bHZhZG1pbjpMYWJWSUVXPT09", "application/json"]
    call "Add Header.gvi"(client handle=s2, header=w15, value=w16, error in=w9) -> (client handle out=w17, error out=w18)
    next s2 = w17
  }
  w19 = "{\"test\":{\"name\":\"@@\"},\"$options\":{\"$rowlimit\":1}}"
  call "Get_Channel_Reference.gviweb"(client handle=s2, Command_Template=w19, id_input=$TDM_File_Name, url=w14) -> (body=w20, client handle out=w21, id_out=w22)
  call "Get_Channel_Reference.gviweb"(client handle=w21, Command_Template="{\"measurement\":{\"test\":@@}}", id_input=w22, url=w14) -> (body=w23, client handle out=w24, id_out=w25)
  call "Get_Channel_Reference.gviweb"(client handle=w24, Command_Template="{\"measurementquantity\":{\"measurement\":@@}}", id_input=w25, url=w14) -> (body=w26, client handle out=w27, id_out=w28)
  w29 = "{\n  \"localcolumn\": {\n    \"measurement_quantity\": @@\n  }\n}"
  call "Get_Channel_Reference.gviweb"(client handle=w27, Command_Template=w29, id_input=w28, url=w14) -> (client handle out=w30, id_out=w31)
  w32 = "{\"localcolumn\":@@,\"$attributes\":{\"id\":1,\"values\":1,\"flags\":1},\"$options\":{\"$valskip\":0,\"$vallimit\":250}}"
  call "Get_Channel_Data.gviweb"(client handle=w30, Command_Template=w32, id_input=w31, url=w14) -> (Graph=w33, error out=w34)
  $Graph <- w33
  $"error out" <- w34
  Unflatten From Json(JSON string=w20, path=["matrices", "0", "columns", "2", "stringArray", "values"], type and defaults=string[] []) -> (value=w35)
  Unflatten From Json(JSON string=w23, path=["matrices", "0", "columns", "1", "stringArray", "values"], type and defaults=string[] []) -> (value=w36)
  Unflatten From Json(JSON string=w26, path=["matrices", "0", "columns", "1", "stringArray", "values"], type and defaults=string[] []) -> (value=w37)
  Unflatten From Json(JSON string=w26, path=["matrices", "0", "columns", "4", "stringArray", "values"], type and defaults=string[] []) -> (value=w38)
  call "Populate_TDM_Tree.gviweb"(Channel_Unit=w38, Channel=w37, Channel Group=w36, FileLevel=w35) -> (Output=w39)
  $Tree <- w39
